% Simulink design studies des_run_test_1.mldatx for model test_big_model

study "DesignStudy": 4636 simulations
  combinatorial set ( points):
    "Variable_1": Variable(Name=ctrl_tm), values [1.5:0.1:9] (76 points)
    "Variable_2": Variable(Name=ctrl_k), values [0.15:0.01:0.75] (61 points)